# Grasshopper definition Jansen's linkage.gh (Grasshopper 1.0.7)
# Copyright: KAJIMA DESIGN
# plug-ins: Kangaroo2 Components

pt = Point([Point(51.52702998, 94.7770184, 0), Point(89.52702998, 94.7770184, 0), Point(89.52702998, 102.5770184, 0)])
line = Line(Line((89.52702998, 102.5770184, 0), (89.52702998, 117.5770184, 0)))
# ②Kangarooで動かす(Grab)
crv = Curve([<curve referenced from the Rhino model> x13])
# ③Control Knobで動かす
crv_2 = Curve([<curve referenced from the Rhino model> x13])
pt_2 = Point([Point(51.52702998, 94.7770184, 0), Point(89.52702998, 94.7770184, 0), Point(89.52702998, 102.5770184, 0)])
knob = ControlKnob(Decimals=0, Limit=True, Maximum=36000, Minimum=0, Range=360, Value=0)
rad = Radians(Degrees=knob)
end = EndPoints(Curve=line)  # -> Start, End
neg = Negative(Value=rad)
number_slider = Slider(3, range=1..20)
number_slider_2 = Slider(3, range=1..20)
end_2 = EndPoints(Curve=crv)  # -> Start, End
end_3 = EndPoints(Curve=crv_2)  # -> Start, End
cullpt = CullDuplicates(Points=[end_2.Start, end_2.End], Tolerance=0.1, CullMode=3)  # -> Points, Indices, Valence
cullpt_2 = CullDuplicates(Points=[end_3.Start, end_3.End], Tolerance=0.1, CullMode=3)  # -> Points, Indices, Valence
rotate = Rotate(Geometry=end.End, Angle=neg, Plane=end.Start)  # -> Geometry, Transform
grab = Grab(On=True, Strength=1, Range=number_slider)
anchor = Anchor(Point=pt, Target=pt, Strength=10000)
grab_2 = Grab(On=True, Strength=1, Range=number_slider_2)
length_line = LengthLine(Line=crv, Strength=10)
onplane = OnPlane(Points=cullpt.Points, Plane=PlaneXY(0, 0, 0), Strength=1)
anchor_2 = Anchor(Point=pt_2, Target=pt_2, Strength=10000)
anchor_3 = Anchor(Point=end.End, Target=rotate.Geometry, Strength=10000)
length_line_2 = LengthLine(Line=crv_2, Strength=10)
onplane_2 = OnPlane(Points=cullpt_2.Points, Plane=PlaneXY(0, 0, 0), Strength=1)
show = Show(G=crv)
show_2 = Show(G=crv_2)
entwine = Entwine(Branch00=show, Branch01=[length_line, grab, anchor, onplane], FlattenInputs=True)
entwine_2 = Entwine(Branch00=show_2, Branch01=[length_line_2, grab_2, anchor_2, onplane_2, anchor_3], FlattenInputs=True)
solver = Solver(GoalObjects=entwine, Reset=Button(), Threshold=1e-15, Tolerance=0.0001, On=Toggle(True))  # -> I, V, O
solver_2 = Solver(GoalObjects=entwine_2, Reset=Button(), Threshold=1e-15, Tolerance=0.0001, On=Toggle(True))  # -> I, V, O
dots = DotDisplay(Point=solver.V, Colour=RGB(0, 0, 0), Size=number_slider)
dots_2 = DotDisplay(Point=solver_2.V, Colour=RGB(0, 0, 0), Size=number_slider_2)
